# Grasshopper definition curve_tools.gh (Grasshopper 1.0.7)
# plug-ins: treesloth01

panel = Panel("""X=0.000 Y=0.000 Z=0.000
X=-0.021 Y=-6.269 Z=0.000
X=-0.710 Y=-25.632 Z=4.123
X=-6.557 Y=-73.782 Z=13.065
X=-26.006 Y=-143.872 Z=22.957
X=-60.961 Y=-214.682 Z=33.085
X=-98.517 Y=-265.115 Z=44.712
X=-124.533 Y=-290.409 Z=61.224
X=-135.840 Y=-295.397 Z=86.708
X=-140.773 Y=-286.531 Z=126.920
X=-144.235 Y=-261.176 Z=182.705
X=-153.505 Y=-222.803 Z=243.427
X=-167.239 Y=-175.339 Z=296.696
X=-177.085 Y=-128.443 Z=330.803
X=-185.955 Y=-79.886 Z=354.452
X=-189.009 Y=-29.360 Z=365.363
X=-190.198 Y=14.564 Z=367.005
X=-192.525 Y=54.425 Z=363.995
X=-193.893 Y=95.585 Z=354.669
X=-193.599 Y=137.025 Z=338.079
X=-189.447 Y=176.630 Z=312.763
X=-181.791 Y=208.809 Z=282.388
X=-171.468 Y=227.301 Z=255.324
X=-159.221 Y=238.913 Z=228.907
X=-143.318 Y=244.810 Z=200.114
X=-122.402 Y=246.929 Z=161.362
X=-91.978 Y=237.137 Z=104.725
X=-55.773 Y=201.340 Z=39.692
X=-28.463 Y=147.924 Z=-13.202
X=-14.951 Y=100.744 Z=-41.209""")
pt = Point([Point(122.2077961, 63.3394111, 0), Point(139.1416082, 89.79849247, 0), Point(119.5618879, 134.2497492, 0), Point(69.81881497, 156.4753775, 0), Point(99.4529861, 105.6739413, 0), Point(111.0949819, 108.3198494, 0)])
python = GhPythonScript(pt=panel)  # -> out, a
# ---------- python: Python ----------
__author__ = "mazhuravlev"
__version__ = "2021.09.11"

import rhinoscriptsyntax as rs
import Rhino.Geometry as rg

parts = pt.split(" ")
ns = map(lambda x: float(x[2:]), parts)
a =rg.Point3d(ns[0], ns[1], ns[2])
# ---------- end python ----------
pline = PolyLine(Vertices=pt, Closed=False)
pline_2 = PolyLine(Vertices=python.a, Closed=False)
python_2 = GhPythonScript(pts=pt, param=Slider(0, range=0..1))  # -> out, a; inputs pts: list of Point3d
# ---------- python_2: Python ----------
__author__ = "mazhuravlev"
__version__ = "2021.09.11"

import rhinoscriptsyntax as rs
import itertools
import Rhino.Geometry as rg

def pairwise(iterable):
    a, b = itertools.tee(iterable)
    next(b, None)
    return zip(a, b)
    
lines = map(lambda x:rg.Line(x[0], x[1]), pairwise(pts))
lens = map(lambda x: x.Length, lines)
totalLength = sum(lens)
paramLength = totalLength * param
acc = 0
i = 0
while acc <= paramLength:
    l = lens[i]
    if paramLength >= acc and paramLength <= acc + l:
        segmentParam = (paramLength - acc) / l
        a = lines[i].PointAt(segmentParam)
        break
    i += 1
    acc += l
# ---------- end python_2 ----------
range = Range(Domain=Domain(0, 1), Steps=Slider(21, range=0..100))
python_3 = GhPythonScript(pts=python.a, param=range)  # -> out, a; inputs pts: list of Point3d; same code as python_2
panel_2 = Panel(python_2.a)
lng = ListLength(List=python_3.a)
dom = ConstructDomain(DomainStart=1, DomainEnd=lng)
first_last = FirstLast(List=python_3.a)  # -> FirstValue, LastValue
subset = SubList(List=python_3.a, Domain=dom, Wrap=False)  # -> List, Index
dist = Distance(PointA=first_last.FirstValue, PointB=subset.List)
pline_3 = PolyLine(Vertices=subset.List, Closed=False)
tag = TextTag(Location=subset.List, Text=dist)
