# Grasshopper definition gesture_curves.gh (Grasshopper 1.0.7)
# plug-ins: Heteroptera

crv = Curve(graft([<curve referenced from the Rhino model> x7]))
item = ListItem(List=flatten(crv), Index=0, Wrap=True)
dom = ConstructDomain(DomainStart=0, DomainEnd=1)
range = Range(Domain=dom, Steps=10)
eval = EvaluateLength(Curve=crv, Length=range, Normalized=True)  # -> Point, Tangent, Parameter
item_2 = ListItem(List=eval.Point, Index=0, Wrap=True)
dist = Distance(PointA=item_2, PointB=eval.Point)
normal = ListNormalizer(Numbers=dist, istree=False)  # -> simplify(Numbers)
branch = TreeBranch(Tree=normal, Path="{0}", MaintainPaths=True)

python = GhPythonScript(ref=branch, cmp=normal)  # -> out, stddev; inputs ref: list, cmp: list
# ---------- python: Python ----------
__author__ = "mazhuravlev"
__version__ = "2021.09.09"

import rhinoscriptsyntax as rs

data = map(lambda z: z[0] - z[1], zip(ref, cmp))
mean = sum(data)/len(data)
variance = sum([((x - mean) ** 2) for x in data]) / (len(data) - 1)
stddev = variance ** 0.5
# ---------- end python ----------
smaller = SmallerThan(FirstNumber=python.stddev, SecondNumber="0.05")  # -> SmallerThan, OrEqualTo

center = Center(Geometry=crv)  # -> flatten(Center), flatten(Dimension)
txt = Text(flatten(python.stddev))
tag = TextTag(Location=center.Center, Text=txt)

similar = Similarity(FirstNumber=branch, SecondNumber=normal, Threshold=0.1)  # -> Similarity, AbsoluteDifference
python_2 = GhPythonScript(x=similar.Similarity)  # -> out, a; inputs x: list of Boolean
# ---------- python_2: Python ----------
__author__ = "mazhuravlev"
__version__ = "2021.09.09"

import rhinoscriptsyntax as rs

a = all(x)
# ---------- end python_2 ----------

cull = CullPattern(List=crv, CullPattern=smaller.SmallerThan)
